# Grasshopper definition blue density2.gh (Grasshopper 1.0.7)
# plug-ins: ShapeDiverForGrasshopper, BitmapComponent, GrasshopperHyperGooComponents, MeshEdit Components, Weaverbird

# ----
# blue  Density 2
number_slider = Slider(36, range=0..100)
number_slider_2 = Slider(33, range=0..100)
srf = Surface(<surface referenced from the Rhino model>)
srf_2 = Surface(<surface referenced from the Rhino model>)
divide = DivideDomain²(Domain=srf, UCount=number_slider, VCount=number_slider_2)
divide_2 = DivideDomain²(Domain=srf_2, UCount=number_slider, VCount=number_slider_2)
subsrf = Isotrim(Surface=srf, Domain=divide)
subsrf_2 = Isotrim(Surface=srf_2, Domain=divide_2)
number_slider_3 = Slider(9, range=0..100)
lng = ListLength(List=subsrf)
lng_2 = ListLength(List=subsrf_2)
random = Random(Range=lng_2, Number=number_slider_3, Seed=Slider(9, range=0..10))
random_2 = Random(Range=lng, Number=number_slider_3, Seed=2)
round = Round(Number=random_2)  # -> Nearest, Floor, Ceiling
round_2 = Round(Number=random)  # -> Nearest, Floor, Ceiling
cull_i = CullIndex(List=subsrf, Indices=round.Floor, Wrap=True)
item = ListItem(List=subsrf, Index=round.Floor, Wrap=True)
cull_i_2 = CullIndex(List=subsrf_2, Indices=round_2.Floor, Wrap=True)
item_2 = ListItem(List=subsrf_2, Index=round_2.Floor, Wrap=True)
graft = GraftTree(Tree=item_2, IncludeEmptyLists=True, IncludeNullItems=True)
graft_2 = GraftTree(Tree=item, IncludeEmptyLists=True, IncludeNullItems=True)
merge = Merge(Data1=graft_2, Data2=graft)
loft = Loft(Curves=merge, Options={Adjust=False, Closed=False, LoftEnds=0, LoftSimp=0, LoftType=0, Rebuild=10, Refit=0.01})
join = BrepJoin(Breps=flatten([cull_i, loft, cull_i_2]))  # -> Breps, Closed
smesh = SimpleMesh(Brep=join.Breps)
mjoin = MeshJoin(Meshes=smesh)
weldvertices = MeshWeldVertices(Mesh=mjoin, Tolerance=0.01)  # -> RuntimeMessage, Mesh
wbloop = WeaverbirdsLoopSubdivision(MeshCurves=weldvertices.Mesh, Level=1, SmoothNakedEdges=Slider(0, range=0..10))

# ----
# https://gltf-viewer.donmccurdy.com/
sddb = ShapeDiverDatabase({AbsoluteTolerance=-1, AngleTolerance=-1, AppDescription="", AppName="unnamed", DocumentName="unnamed", InputGroups="{\"fedd18c5-3526-49ec-9466-f1f78a203439\":{\"name\":\"SDInput\",\"guid\":\"fedd18c5-3526-49ec-9466-f1f78a203439\",\"index\":0,\"params\":[\"5cfc4f94-4dc6-43b3-b239-66f245636797\"],\"indexFloor\":0,\"indexCeiling\":0}}", OutputGroups="{}", RelativeTolerance=-1, UnitSystem=-1})
box = DomainBox(Base=PlaneXY(0, 0, 0), X=Domain(-2, 2), Y=Domain(-0.5, 0.5), Z=Domain(0, 0.25))
bmp_wood_pattern = Bitmap(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)
bmp_levelsets = Bitmap(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)
bmp_tile_water = Bitmap(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)
bmp_tile_weave = Bitmap(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)
bmp_tile_rings = Bitmap(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)
bmp_tile_aqua = Bitmap(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)
bmp_tile_disks = Bitmap(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)
mesh = Mesh(box)
orientsplit = SplitByOrientation(Geometry=mesh, Plane=PlaneXY(0, 0, 0), Dx=Domain(0, 1), Dy=Domain(0, 1), AngleTol=45, MeshYN=False)  # -> Top, Bottom, Back, Front, Right, Left, Planar, Unplanar
advancedmaterial = AdvancedMaterial(Color=ColourSwatch(SwatchColor=RGB(38, 177, 237)), ColorMap=bmp_tile_disks, FlatShading=False)
mesh_2 = Mesh([orientsplit.Top, orientsplit.Bottom, orientsplit.Back, orientsplit.Front, orientsplit.Right, orientsplit.Left])
exsdmaterial = ExplodeShapeDiverMaterial(Material=advancedmaterial)  # -> Color, ColorMap, Metalness, MetalnessMap, Roughness, RoughnessMap, Opacity, OpacityMap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
constructattr = ConstructAttributes(Keys="material", Values=graft(advancedmaterial))  # -> flatten(Attributes)
panel = Panel(exsdmaterial.Color)
panel_2 = Panel(advancedmaterial)
injectattr = InjectAttributes(Object=wbloop, Attributes=constructattr)
toggle = BooleanToggle(True)
brep = Brep(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)
crv = Curve(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)
mesh_3 = Mesh(injectattr)
path = FilePath("C:\Users\epoulsen\Documents\TEMP\shapediver-export.glb")
merge_2 = Merge(Data1=crv, Data2=brep, Data3=mesh_3)  # -> flatten(Result)
sdinput = ShapeDiverInput(In0=mesh_3, ParameterSchemas="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")
gltfexport = GlTF20Exporter(Data=mesh_3)
update_this_path = Panel("C:\Users\91343\Downloads\output2.glb")
c_script = CSharpScript(input=gltfexport, path=update_this_path, trigger=Toggle(True))  # -> out, A; inputs path: String, trigger: Boolean
# ---------- c_script: C# ----------
    if(trigger){
      try {
        System.IO.Stream stream = input as System.IO.Stream;
        using (var fileStream = System.IO.File.Create(path))
        {
          stream.Seek(0, System.IO.SeekOrigin.Begin);
          stream.CopyTo(fileStream);
          A = "File saved successfully.";
        }
      }
      catch(Exception e){
        A = "An error occurred";
        throw e;
      }
    } else {
      A = "Nothing saved. Set the trigger to 'True' to save files.";
    }
# ---------- end c_script ----------
status = Panel(c_script.A)
